% Simulink data dictionary monopod_controller_parameter.sldd

trq_max = Simulink.Parameter(2.7)
f_c = Simulink.Parameter(1000)
HHC_k_p = Simulink.Parameter(10)
IC_k1 = Simulink.Parameter(4)
IC_k2 = Simulink.Parameter(10)
IC_d1 = Simulink.Parameter(2)
IC_d2 = Simulink.Parameter(2)
g = Simulink.Parameter(9.81)  % Gravitational Constant
m_1 = Simulink.Parameter(0.158)  % Mass Upper Leg 158g
m_2 = Simulink.Parameter(0.062)  % Mass Lower Leg 62g
I_1 = Simulink.Parameter(0.1)  % Inertia Upper Leg 0.1
m_body = Simulink.Parameter(0.1)  % Mass Body 0.1
I_body = Simulink.Parameter(0.1)  % Inertia Body 0.1
I_2 = Simulink.Parameter(0.1)  % Inertia Lower Leg 0.1
l_1 = Simulink.Parameter(0.16)  % Length Upper Leg 160mm
l_2 = Simulink.Parameter(0.16)  % Length Lower Leg 160mm
HHC_t_max = Simulink.Parameter(0.1)